# Grasshopper definition udp_gh_.gh (Grasshopper 1.0.7)

c_script = CSharpScript()  # -> out, A
# ---------- c_script: C# ----------
    string[] Str = x.Split(new string[] {"!"}, StringSplitOptions.RemoveEmptyEntries);
# ---------- end c_script ----------
brep = Brep(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)
brep_2 = Brep(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)
